% Simulink data dictionary BldcData.sldd

BldcInput_Default = Simulink.Parameter(struct(
  CurrentRaw=uint16([32768; 32768; 32768]),
  Hall=uint8(5),
  TerminalVoltage=single([6; 6; 6]),
  Control=uint8(0),
  Fault=false,
  CommandEvent=true,
  DrivingEvent=true,
  TimerEvent=true,
  SpeedReq=single(0),
  Vdc=single(12),
  AppliedSector=uint8(0),
  AppliedDirection=int8(1),
  VoltageValid=true), DataType="Bus: tBldcInput")

AmbdOutputsArmed = Simulink.Parameter(false, StorageClass="ExportedGlobal", Alias="Ambd_OutputsArmed", DataType="boolean")

BldcControl_Params = Simulink.Parameter(struct(
  Ts=single(6.25e-5),
  SpeedDivider=uint16(16),
  AdcOffset=single(32768),
  AdcCountsPerAmp=single(1000),
  PwmPeriod=uint16(65535),
  Rs=single(0.56),
  Ls=single(0.0004),
  Ke=single(0.00781045202),
  PolePairs=uint8(2),
  Inertia=single(1.2e-5),
  Friction=single(0.0005),
  PlantSubsteps=uint16(10),
  NominalVdc=single(12),
  VdcMin=single(8),
  VdcMax=single(16),
  CurrentLimit=single(6),
  TripCurrent=single(10),
  SpeedLimit=single(250),
  MaxModulation=single(0.95),
  KpCurrent=single(2.51327419),
  KiCurrent=single(3518.58398),
  KpSpeed=single(0.0226098206),
  KiSpeed=single(0.970476091),
  SpeedSlew=single(200),
  CurrentSlew=single(60),
  AlignTime=single(0.15),
  AlignCurrent=single(1.2),
  OpenCurrent=single(3.5),
  OpenAccel=single(100),
  OpenSpeed=single(120),
  TrackingTime=single(0.15),
  TrackingTimeout=single(1),
  StartTimeout=single(3),
  StopSpeed=single(8),
  StopTimeout=single(1.5),
  StopCoastTime=single(0.25),
  HallTimeout=single(0.3),
  HallStartTimeout=single(1),
  HallStallCurrent=single(0.5),
  SpeedFilterAlpha=single(0.02),
  HallGainSpeed=single(80),
  HallMinGainScale=single(0.2),
  ZcBlankTicks=uint16(4),
  ZcHysteresis=single(0.02),
  FloatCurrentLimit=single(0.05),
  ZcMinTicks=uint32(20),
  ZcMaxTicks=uint32(8000),
  ZcRequired=uint16(6),
  ZcTimeoutFactor=single(2.5),
  ZcMinSpeed=single(60),
  AcquireSpacing=uint16(4),
  AcquireMinVoltage=single(0.2),
  AcquireTimeout=single(0.01),
  LowSpeedThreshold=single(75),
  PositionMode=uint8(0),
  CurrentSenseMode=uint8(0),
  MinModulation=single(0),
  DemagBlankFraction=single(0.2),
  DemagRailMargin=single(0.3),
  DemagReleaseTicks=uint16(2),
  ActuationDelayTicks=uint16(0)), DataType="Bus: tBldcParams")

BldcRuntime_Init = Simulink.Parameter(struct(
  Parameters=struct(
    Ts=single(6.25e-5),
    SpeedDivider=uint16(16),
    AdcOffset=single(32768),
    AdcCountsPerAmp=single(1000),
    PwmPeriod=uint16(65535),
    Rs=single(0.56),
    Ls=single(0.0004),
    Ke=single(0.00781045202),
    PolePairs=uint8(2),
    Inertia=single(1.2e-5),
    Friction=single(0.0005),
    PlantSubsteps=uint16(10),
    NominalVdc=single(12),
    VdcMin=single(8),
    VdcMax=single(16),
    CurrentLimit=single(6),
    TripCurrent=single(10),
    SpeedLimit=single(250),
    MaxModulation=single(0.95),
    KpCurrent=single(2.51327419),
    KiCurrent=single(3518.58398),
    KpSpeed=single(0.0226098206),
    KiSpeed=single(0.970476091),
    SpeedSlew=single(200),
    CurrentSlew=single(60),
    AlignTime=single(0.15),
    AlignCurrent=single(1.2),
    OpenCurrent=single(3.5),
    OpenAccel=single(100),
    OpenSpeed=single(120),
    TrackingTime=single(0.15),
    TrackingTimeout=single(1),
    StartTimeout=single(3),
    StopSpeed=single(8),
    StopTimeout=single(1.5),
    StopCoastTime=single(0.25),
    HallTimeout=single(0.3),
    HallStartTimeout=single(1),
    HallStallCurrent=single(0.5),
    SpeedFilterAlpha=single(0.02),
    HallGainSpeed=single(80),
    HallMinGainScale=single(0.2),
    ZcBlankTicks=uint16(4),
    ZcHysteresis=single(0.02),
    FloatCurrentLimit=single(0.05),
    ZcMinTicks=uint32(20),
    ZcMaxTicks=uint32(8000),
    ZcRequired=uint16(6),
    ZcTimeoutFactor=single(2.5),
    ZcMinSpeed=single(60),
    AcquireSpacing=uint16(4),
    AcquireMinVoltage=single(0.2),
    AcquireTimeout=single(0.01),
    LowSpeedThreshold=single(75),
    PositionMode=uint8(0),
    CurrentSenseMode=uint8(0),
    MinModulation=single(0),
    DemagBlankFraction=single(0.2),
    DemagRailMargin=single(0.3),
    DemagReleaseTicks=uint16(2),
    ActuationDelayTicks=uint16(0)),
  Mode=uint8(0),
  PreviousMode=uint8(0),
  ModeTicks=uint32(0),
  Tick=uint32(0),
  SlowCounter=uint16(0),
  FastTick=false,
  SpeedTick=false,
  Command=uint8(0),
  SpeedRequest=single(0),
  SpeedRamped=single(0),
  CoastTicks=uint32(0),
  Direction=int8(1),
  OutputDirection=int8(1),
  Sector=uint8(0),
  GateEnable=false,
  PhaseEnable=[false; false; false],
  DutyCounts=uint16([0; 0; 0]),
  Modulation=single(0),
  Current=single([0; 0; 0]),
  CurrentRef=single(0),
  CurrentDemand=single(0),
  CurrentMeasured=single(0),
  CurrentIntegrator=single(0),
  SpeedIntegrator=single(0),
  SpeedEstimate=single(0),
  ControlSpeed=single(0),
  RawSpeed=single(0),
  HallLast=uint8(0),
  HallSector=uint8(0),
  HallAge=uint32(0),
  HallValid=false,
  HallDirection=int8(0),
  FeedbackReady=false,
  OmegaOpen=single(0),
  ThetaOpen=single(2.61799383),
  AppliedLastSector=uint8(0),
  AppliedAge=uint32(0),
  ZcAge=uint32(0),
  ZcPeriod=single(0),
  ZcCount=uint16(0),
  ZcFound=false,
  ZcArmed=false,
  ZcValue=single(0),
  ZcCountdown=int32(-1),
  ZcNextSector=uint8(0),
  AcquireStage=uint8(0),
  AcquireTheta=single(0),
  AcquireAge=uint32(0),
  AcquisitionReady=false,
  SensorFault=uint16(0),
  ActiveFaults=uint16(0),
  FaultBits=uint16(0),
  PhaseCurrentsValid=true,
  DcCurrent=single(0),
  DcCurrentValid=false,
  ZcUnclampedCount=uint16(0)), DataType="Bus: tBldcRuntime")

BldcPlant_Params = Simulink.Parameter(struct(
  Ts=single(6.25e-5),
  SpeedDivider=uint16(16),
  AdcOffset=single(32768),
  AdcCountsPerAmp=single(1000),
  PwmPeriod=uint16(65535),
  Rs=single(0.56),
  Ls=single(0.0004),
  Ke=single(0.00781045202),
  PolePairs=uint8(2),
  Inertia=single(1.2e-5),
  Friction=single(0.0005),
  PlantSubsteps=uint16(10),
  NominalVdc=single(12),
  VdcMin=single(8),
  VdcMax=single(16),
  CurrentLimit=single(6),
  TripCurrent=single(10),
  SpeedLimit=single(250),
  MaxModulation=single(0.95),
  KpCurrent=single(2.51327419),
  KiCurrent=single(3518.58398),
  KpSpeed=single(0.0226098206),
  KiSpeed=single(0.970476091),
  SpeedSlew=single(200),
  CurrentSlew=single(60),
  AlignTime=single(0.15),
  AlignCurrent=single(1.2),
  OpenCurrent=single(3.5),
  OpenAccel=single(100),
  OpenSpeed=single(120),
  TrackingTime=single(0.15),
  TrackingTimeout=single(1),
  StartTimeout=single(3),
  StopSpeed=single(8),
  StopTimeout=single(1.5),
  StopCoastTime=single(0.25),
  HallTimeout=single(0.3),
  HallStartTimeout=single(1),
  HallStallCurrent=single(0.5),
  SpeedFilterAlpha=single(0.02),
  HallGainSpeed=single(80),
  HallMinGainScale=single(0.2),
  ZcBlankTicks=uint16(4),
  ZcHysteresis=single(0.02),
  FloatCurrentLimit=single(0.05),
  ZcMinTicks=uint32(20),
  ZcMaxTicks=uint32(8000),
  ZcRequired=uint16(6),
  ZcTimeoutFactor=single(2.5),
  ZcMinSpeed=single(60),
  AcquireSpacing=uint16(4),
  AcquireMinVoltage=single(0.2),
  AcquireTimeout=single(0.01),
  LowSpeedThreshold=single(75),
  PositionMode=uint8(0),
  CurrentSenseMode=uint8(0),
  MinModulation=single(0),
  DemagBlankFraction=single(0.2),
  DemagRailMargin=single(0.3),
  DemagReleaseTicks=uint16(2),
  ActuationDelayTicks=uint16(0)), DataType="Bus: tBldcParams")

BldcBool_T = Simulink.AliasType(BaseType="boolean")  % BLDC 逻辑存储
BldcCurrent_V = Simulink.ValueType(DataType="BldcSingle_T", Unit="A", be=Simulink.BusElement(Name="a", DataType="double"))  % 相电流
BldcInt32_T = Simulink.AliasType(BaseType="int32")  % BLDC 有符号 32 位存储
BldcInt8_T = Simulink.AliasType(BaseType="int8")  % BLDC 有符号 8 位存储
BldcRaw16_T = Simulink.NumericType(DataTypeMode="Fixed-point: binary point scaling", SignednessBool=false, WordLength=16, FixedExponent=0)  % 无符号 16 位原始表示
BldcSingle_T = Simulink.AliasType(BaseType="single")  % BLDC 单精度存储
BldcTime_V = Simulink.ValueType(DataType="BldcSingle_T", Min=0, Unit="s", be=Simulink.BusElement(Name="a", DataType="double"))  % 以秒为单位的时间
BldcUInt16_T = Simulink.AliasType(BaseType="uint16")  % BLDC 无符号 16 位存储
BldcUInt32_T = Simulink.AliasType(BaseType="uint32")  % BLDC 无符号 32 位存储
BldcUInt8_T = Simulink.AliasType(BaseType="uint8")  % BLDC 无符号 8 位存储
BldcVoltage_V = Simulink.ValueType(DataType="BldcSingle_T", Unit="V", be=Simulink.BusElement(Name="a", DataType="double"))  % 测量电压

eBldcPositionMode = enum(DefaultValue="Hall", StorageType="uint8")
  Hall = 0  % 霍尔边沿反馈
  Sensorless = 1  % 端电压过零反馈

tBldcDebug = Simulink.Bus()  % 固定尺寸的 BLDC 调试接口。
  Enabled: BldcBool_T  % 调试使能
  Data: BldcSingle_T[16]  % 16 个有序监视通道，见 bldc.monitor

tBldcInput = Simulink.Bus()  % 固定尺寸的 BLDC 输入接口。
  CurrentRaw: BldcUInt16_T[3]  % 相电流 ADC 编码；直流母线模式仅使用第 1 个元素
  Hall: BldcUInt8_T  % 霍尔编码
  TerminalVoltage: BldcSingle_T[3]  % 三相端电压；直流母线模式仅校验实际悬浮相
  Control: BldcUInt8_T  % 控制命令
  Fault: BldcBool_T  % 外部故障输入
  CommandEvent: BldcBool_T  % 命令事件
  DrivingEvent: BldcBool_T  % 驱动节拍事件
  TimerEvent: BldcBool_T  % 定时事件
  SpeedReq: BldcSingle_T  % 请求电角速度
  Vdc: ValueType: BldcVoltage_V  % 直流母线电压
  AppliedSector: BldcUInt8_T  % 采样区间实际生效的扇区
  AppliedDirection: BldcInt8_T  % 采样区间实际生效的方向
  VoltageValid: BldcBool_T  % 端电压采样有效标志

tBldcMonitor = Simulink.Bus()  % 固定尺寸的 BLDC 监视接口。
  Mode: BldcUInt8_T  % 当前模式
  FaultBits: BldcUInt16_T  % 锁存故障位
  Tick: BldcUInt32_T  % 快速节拍计数
  Current: BldcSingle_T[3]  % 三相电流，单位 A
  CurrentReference: ValueType: BldcCurrent_V  % 电流参考
  CurrentDemand: ValueType: BldcCurrent_V  % 变化率限制前已限幅的速度环电流需求
  SpeedRequest: BldcSingle_T  % 已锁存速度请求
  SpeedRamped: BldcSingle_T  % 变化率限制后的速度请求
  SpeedEstimate: BldcSingle_T  % 估算电角速度
  ControlSpeed: BldcSingle_T  % 控制所用电角速度
  Sector: BldcUInt8_T  % 换相扇区
  Direction: BldcInt8_T  % 控制方向
  OutputDirection: BldcInt8_T  % 输出方向
  Modulation: BldcSingle_T  % 调制度
  GateEnable: BldcBool_T  % 全局门极使能
  PhaseEnable: BldcBool_T[3]  % 各相桥臂使能
  FeedbackReady: BldcBool_T  % 反馈就绪标志
  ZcCount: BldcUInt16_T  % 有效过零计数
  ZcPeriod: BldcSingle_T  % 估算的过零周期
  ZcCountdown: BldcInt32_T  % 换相倒计时
  AcquisitionReady: BldcBool_T  % 滑行端电压捕获已通过有效性确认
  PositionMode: BldcUInt8_T  % 0 霍尔；1 端电压无感
  VoltageResidual: BldcSingle_T  % 端电压残差
  CurrentIntegrator: BldcSingle_T  % 电流环积分状态
  SpeedIntegrator: BldcSingle_T  % 速度环积分状态
  HallSector: BldcUInt8_T  % 霍尔扇区
  HallValid: BldcBool_T  % 霍尔反馈有效标志
  AppliedAge: BldcUInt32_T  % 当前实际生效扇区持续节拍数
  CurrentMeasured: ValueType: BldcCurrent_V  % 用于调节的测量电流
  CurrentSenseMode: BldcUInt8_T  % 0 相电流传感器；1 直流母线分流
  PhaseCurrentsValid: BldcBool_T  % Current 向量有效标志
  DcCurrent: ValueType: BldcCurrent_V  % 最近一次有效母线电流
  DcCurrentValid: BldcBool_T  % 本次母线电流采样有效标志

tBldcParams = Simulink.Bus()  % 固定尺寸的 BLDC 参数接口。
  Ts: ValueType: BldcTime_V  % 快速采样周期
  SpeedDivider: BldcUInt16_T  % 速度环分频系数
  AdcOffset: BldcSingle_T  % ADC 零点偏移
  AdcCountsPerAmp: BldcSingle_T  % 每安培对应的 ADC 计数
  PwmPeriod: BldcUInt16_T  % PWM 周期计数
  Rs: BldcSingle_T  % 相电阻
  Ls: BldcSingle_T  % 相电感
  Ke: BldcSingle_T  % 反电动势系数
  PolePairs: BldcUInt8_T  % 极对数
  Inertia: BldcSingle_T  % 转动惯量
  Friction: BldcSingle_T  % 黏性摩擦系数
  PlantSubsteps: BldcUInt16_T  % 被控对象积分子步数
  NominalVdc: ValueType: BldcVoltage_V  % 标称直流母线电压
  VdcMin: ValueType: BldcVoltage_V  % 母线欠压阈值
  VdcMax: ValueType: BldcVoltage_V  % 母线过压阈值
  CurrentLimit: BldcSingle_T  % 电流参考限值
  TripCurrent: BldcSingle_T  % 过流跳闸阈值
  SpeedLimit: BldcSingle_T  % 速度请求限值
  MaxModulation: BldcSingle_T  % 最大调制度
  KpCurrent: BldcSingle_T  % 电流环比例增益
  KiCurrent: BldcSingle_T  % 电流环积分增益
  KpSpeed: BldcSingle_T  % 速度环比例增益
  KiSpeed: BldcSingle_T  % 速度环积分增益
  SpeedSlew: BldcSingle_T  % 速度请求变化率限值
  CurrentSlew: BldcSingle_T  % 电流参考变化率限值
  AlignTime: BldcSingle_T  % 对齐持续时间
  AlignCurrent: BldcSingle_T  % 对齐电流
  OpenCurrent: BldcSingle_T  % 开环启动电流
  OpenAccel: BldcSingle_T  % 开环电角加速度
  OpenSpeed: BldcSingle_T  % 开环目标电角速度
  TrackingTime: BldcSingle_T  % 跟踪确认时间
  TrackingTimeout: BldcSingle_T  % 跟踪有效性确认的最大持续时间
  StartTimeout: BldcSingle_T  % 启动超时时间
  StopSpeed: BldcSingle_T  % 停止速度阈值
  StopTimeout: BldcSingle_T  % 停止超时时间
  StopCoastTime: BldcSingle_T  % 停止滑行时间
  HallTimeout: BldcSingle_T  % 霍尔运行边沿超时时间
  HallStartTimeout: BldcSingle_T  % 霍尔启动超时时间
  HallStallCurrent: BldcSingle_T  % 霍尔堵转检测电流阈值
  SpeedFilterAlpha: BldcSingle_T  % 速度滤波系数
  HallGainSpeed: BldcSingle_T  % 采用完整霍尔速度环增益时的请求电角速度，单位 rad/s
  HallMinGainScale: BldcSingle_T  % 霍尔比例增益的最小缩放比例；积分增益使用其平方
  ZcBlankTicks: BldcUInt16_T  % 过零检测消隐节拍数
  ZcHysteresis: BldcSingle_T  % 过零检测滞环电压
  FloatCurrentLimit: BldcSingle_T  % 悬浮相电流限值
  ZcMinTicks: BldcUInt32_T  % 有效过零间隔的最小节拍数
  ZcMaxTicks: BldcUInt32_T  % 有效过零间隔的最大节拍数
  ZcRequired: BldcUInt16_T  % 闭环就绪所需有效过零次数
  ZcTimeoutFactor: BldcSingle_T  % 过零超时系数
  ZcMinSpeed: BldcSingle_T  % 过零反馈的最低有效电角速度
  AcquireSpacing: BldcUInt16_T  % 捕获快照间隔节拍数
  AcquireMinVoltage: BldcSingle_T  % 捕获所需最小电压跨度
  AcquireTimeout: BldcSingle_T  % 捕获超时时间
  LowSpeedThreshold: BldcSingle_T  % 低速回退阈值
  PositionMode: BldcUInt8_T  % 0 霍尔；1 端电压无感
  CurrentSenseMode: BldcUInt8_T  % 0 三相电流传感器；1 有效采样窗口内的直流母线分流
  MinModulation: BldcSingle_T  % 直流母线采样模式下通电占空比下限
  DemagBlankFraction: BldcSingle_T  % 换相后排除的区间占换相周期的比例
  DemagRailMargin: BldcSingle_T  % 悬浮端脱离上下钳位电源轨所需的电压裕量
  DemagReleaseTicks: BldcUInt16_T  % 使能过零检测前所需连续未钳位样本数
  ActuationDelayTicks: BldcUInt16_T  % 直流母线采样换相所补偿的输出生效延迟

tBldcRuntime = Simulink.Bus()  % 固定尺寸的 BLDC 运行时接口。
  Parameters: Bus: tBldcParams  % 完整且独立的控制器标定
  Mode: BldcUInt8_T  % 当前模式
  PreviousMode: BldcUInt8_T  % 上一模式
  ModeTicks: BldcUInt32_T  % 当前模式持续节拍数
  Tick: BldcUInt32_T  % 快速节拍计数
  SlowCounter: BldcUInt16_T  % 慢速分频计数器
  FastTick: BldcBool_T  % 快速更新标志
  SpeedTick: BldcBool_T  % 速度环更新标志
  Command: BldcUInt8_T  % 已锁存控制命令
  SpeedRequest: BldcSingle_T  % 已锁存速度请求
  SpeedRamped: BldcSingle_T  % 变化率限制后的速度请求
  CoastTicks: BldcUInt32_T  % 滑行节拍计数
  Direction: BldcInt8_T  % 控制方向
  OutputDirection: BldcInt8_T  % 输出方向
  Sector: BldcUInt8_T  % 换相扇区
  GateEnable: BldcBool_T  % 全局门极使能
  PhaseEnable: BldcBool_T[3]  % 各相桥臂使能
  DutyCounts: BldcUInt16_T[3]  % 三相占空比计数
  Modulation: BldcSingle_T  % 调制度
  Current: BldcSingle_T[3]  % 三相电流，单位 A
  CurrentRef: ValueType: BldcCurrent_V  % 电流参考
  CurrentDemand: ValueType: BldcCurrent_V  % 变化率限制前已限幅的速度环电流需求
  CurrentMeasured: ValueType: BldcCurrent_V  % 用于调节的测量电流
  CurrentIntegrator: BldcSingle_T  % 电流环积分状态
  SpeedIntegrator: BldcSingle_T  % 速度环积分状态
  SpeedEstimate: BldcSingle_T  % 估算电角速度
  ControlSpeed: BldcSingle_T  % 控制所用电角速度
  RawSpeed: BldcSingle_T  % 未滤波电角速度
  HallLast: BldcUInt8_T  % 上一霍尔编码
  HallSector: BldcUInt8_T  % 霍尔扇区
  HallAge: BldcUInt32_T  % 距上一霍尔边沿的节拍数
  HallValid: BldcBool_T  % 霍尔反馈有效标志
  HallDirection: BldcInt8_T  % 霍尔检测方向
  FeedbackReady: BldcBool_T  % 反馈就绪标志
  OmegaOpen: BldcSingle_T  % 开环电角速度
  ThetaOpen: BldcSingle_T  % 开环电角度
  AppliedLastSector: BldcUInt8_T  % 上一实际生效扇区
  AppliedAge: BldcUInt32_T  % 当前实际生效扇区持续节拍数
  ZcAge: BldcUInt32_T  % 距上一过零的节拍数
  ZcPeriod: BldcSingle_T  % 估算的过零周期
  ZcCount: BldcUInt16_T  % 有效过零计数
  ZcFound: BldcBool_T  % 过零检测结果
  ZcArmed: BldcBool_T  % 过零检测已使能标志
  ZcValue: BldcSingle_T  % 过零检测电压值
  ZcCountdown: BldcInt32_T  % 换相倒计时
  ZcNextSector: BldcUInt8_T  % 下一换相扇区
  AcquireStage: BldcUInt8_T  % 捕获阶段
  AcquireTheta: BldcSingle_T  % 捕获电角度
  AcquireAge: BldcUInt32_T  % 捕获阶段节拍计数
  AcquisitionReady: BldcBool_T  % 滑行端电压捕获已通过有效性确认
  SensorFault: BldcUInt16_T  % 传感器故障位
  ActiveFaults: BldcUInt16_T  % 当前活动故障位
  FaultBits: BldcUInt16_T  % 锁存故障位
  PhaseCurrentsValid: BldcBool_T  % 仅在实际测量相电流时为 true
  DcCurrent: ValueType: BldcCurrent_V  % 最近一次有效母线电流，不代表三相电流重建
  DcCurrentValid: BldcBool_T  % 本帧电流在合格的导通窗口内采样
  ZcUnclampedCount: BldcUInt16_T  % 连续观测到悬浮端电压脱离电源轨的次数