% Simulink data dictionary McData.sldd

license_info = struct(
  name="MIT License",
  spdx_id="MIT",
  url="https://opensource.org/license/mit",
  copyright="Copyright (c) 2026 autoMBD",
  holder="autoMBD",
  year=2026,
  language="en+zh",
  full_text="The MIT License \nMIT许可证\n<https://opensource.org/license/mit>\n\nSPDX short identifier / SPDX 短标识符：MIT \n\nCopyright (c) 2026 autoMBD\n版权所有 (c) 2026 autoMBD\n\nPermission is hereby granted, free of charge, to any person obtaining a copy of this software and associated documentation files (the \"Software\"), to deal in the Software without restriction, including without limitation the rights to use, copy, modify, merge, publish, distribute, sublicense, and/or sell copies of the Software, and to permit persons to whom the Software is furnished to do so, subject to the following conditions:\n特此向获得本软件及相关文档（合称\"本软件\"）副本的任何人免费授予不受限制地利用本软件的许可，包括而不限于：使用、复制、修改、合并、发布、分发、分许可和/或销售本软件副本，并允许本软件的接收者也获得前述许可，但须遵守以下条件：\n\nThe above copyright notice and this permission notice shall be included in all copies or substantial portions of the Software.\n以上版权声明及本许可声明应包含在本软件的所有副本或主要部分中。\n\nTHE SOFTWAREISPROVIDED\"ASIS\",WITHOUT WARRANTYOFANYKIND, EXPRESS OR IMPLIED, INCLUDING BUT NOT LIMITEDTO THEWARRANTIESOF MERCHANTABILITY, FITNESS FOR APARTICULAR PURPOSE AND NONINFRINGEMENT. IN NO EVENTSHALLTHEAUTHORSORCOPYRIGHT HOLDERSBELIABLE FORANYCLAIM,DAMAGESOROTHERLIABILITY,WHETHER IN ANACTIONOFCONTRACT,TORTOROTHERWISE,ARISINGFROM,OUTOFORIN CONNECTIONWITHTHESOFTWAREORTHEUSEOROTHERDEALINGSINTHE SOFTWARE.\n本软件系\"按原样\"提供，不包含任何形式的明示或默示保证，包括但不限于适销性、特定目的适用性及不侵权的保证。在任何情况下，无论是在合同、侵权或其他案件中，作者或版权持有人均不对因本软件、或因本软件的使用或其他利用而引起的、引发的或与之相关的任何权利主张、损害赔偿或其他责任承担责任。\n")

AdcBemfRaw_V = Simulink.ValueType(DataType="McUInt16_T", Min=0, Max=65535, be=Simulink.BusElement(Name="a", DataType="double"))  % 反电动势 ADC 原始采样值
AdcCurrentRaw_V = Simulink.ValueType(DataType="McUInt16_T", Min=0, Max=65535, be=Simulink.BusElement(Name="a", DataType="double"))  % 电流 ADC 原始采样值
AdcVoltageRaw_V = Simulink.ValueType(DataType="McUInt16_T", Min=0, Max=65535, be=Simulink.BusElement(Name="a", DataType="double"))  % 电压 ADC 原始采样值
AngleRad_V = Simulink.ValueType(DataType="McSingle_T", Unit="rad", be=Simulink.BusElement(Name="a", DataType="double"))  % 角度量
AngularSpeedRadPerSec_V = Simulink.ValueType(DataType="McSingle_T", Unit="rad/s", be=Simulink.BusElement(Name="a", DataType="double"))  % 角速度量
BemfConst_VsPerRad_V = Simulink.ValueType(DataType="McSingle_T", Unit="V*s/rad", be=Simulink.BusElement(Name="a", DataType="double"))  % 反电动势常数
Count_V = Simulink.ValueType(DataType="McUInt32_T", Min=0, be=Simulink.BusElement(Name="a", DataType="double"))  % 计数量
Current_A_V = Simulink.ValueType(DataType="McSingle_T", Unit="A", be=Simulink.BusElement(Name="a", DataType="double"))  % 电流物理量
DutyCount_V = Simulink.ValueType(DataType="McUInt16_T", Min=0, Max=65535, be=Simulink.BusElement(Name="a", DataType="double"))  % PWM 占空比计数值
DutyRatio_V = Simulink.ValueType(DataType="McSingle_T", Min=0, Max=1, Unit="1", be=Simulink.BusElement(Name="a", DataType="double"))  % 归一化占空比
EncoderLevel_V = Simulink.ValueType(DataType="McUInt8_T", Min=0, Max=1, be=Simulink.BusElement(Name="a", DataType="double"))  % 编码器数字接口电平
Flux_Wb_V = Simulink.ValueType(DataType="McSingle_T", Min=0, Unit="Wb", be=Simulink.BusElement(Name="a", DataType="double"))  % 磁链量
Freq_Hz_V = Simulink.ValueType(DataType="McUInt32_T", Min=0, Unit="Hz", be=Simulink.BusElement(Name="a", DataType="double"))  % 频率配置量
Gain_V = Simulink.ValueType(DataType="McSingle_T", Unit="1", be=Simulink.BusElement(Name="a", DataType="double"))  % 无量纲增益或系数
HallLevel_V = Simulink.ValueType(DataType="McUInt8_T", Min=0, Max=1, be=Simulink.BusElement(Name="a", DataType="double"))  % 霍尔数字量采样
Inductance_H_V = Simulink.ValueType(DataType="McSingle_T", Min=0, Unit="H", be=Simulink.BusElement(Name="a", DataType="double"))  % 电感量
Inertia_KgM2_V = Simulink.ValueType(DataType="McSingle_T", Min=0, Unit="kg*m^2", be=Simulink.BusElement(Name="a", DataType="double"))  % 转动惯量
LogicBool_V = Simulink.ValueType(DataType="McBool_T", Min=0, Max=1, be=Simulink.BusElement(Name="a", DataType="double"))  % 通用逻辑量
McBool_T = Simulink.AliasType(BaseType="boolean")  % 逻辑开关与使能标志
McInt8_T = Simulink.AliasType(BaseType="int8")  % 通用 8 位有符号代码类型
McS8Idx_T = Simulink.NumericType(DataTypeMode="Fixed-point: binary point scaling", SignednessBool=true, WordLength=8, FixedExponent=0)  % 8 位有符号索引或编号量
McSingle_T = Simulink.AliasType(BaseType="single")  % 通用 32 位浮点代码类型
McU16Raw_T = Simulink.NumericType(DataTypeMode="Fixed-point: binary point scaling", SignednessBool=false, WordLength=16, FixedExponent=0)  % 16 位无符号原始编码，适用于 ADC/PWM/调参原始量
McU32Cnt_T = Simulink.NumericType(DataTypeMode="Fixed-point: binary point scaling", SignednessBool=false, WordLength=32, FixedExponent=0)  % 32 位无符号计数、频率或时间基准载体
McU8Raw_T = Simulink.NumericType(DataTypeMode="Fixed-point: binary point scaling", SignednessBool=false, WordLength=8, FixedExponent=0)  % 8 位无符号原始编码，适用于数字量与轻量状态载体
McUInt16_T = Simulink.AliasType(BaseType="uint16")  % 通用 16 位无符号代码类型
McUInt32_T = Simulink.AliasType(BaseType="uint32")  % 通用 32 位无符号代码类型
McUInt8_T = Simulink.AliasType(BaseType="uint8")  % 通用 8 位无符号代码类型
MotorIndex_V = Simulink.ValueType(DataType="McInt8_T", Min=-128, Max=127, be=Simulink.BusElement(Name="a", DataType="double"))  % 电机编号或实例索引
PolePairCount_V = Simulink.ValueType(DataType="McUInt8_T", Min=0, Max=255, be=Simulink.BusElement(Name="a", DataType="double"))  % 极对数
Resistance_Ohm_V = Simulink.ValueType(DataType="McSingle_T", Min=0, Unit="Ohm", be=Simulink.BusElement(Name="a", DataType="double"))  % 电阻量
ResolverLevel_V = Simulink.ValueType(DataType="McUInt8_T", Min=0, Max=1, be=Simulink.BusElement(Name="a", DataType="double"))  % 旋变数字接口电平
SpeedRpm_V = Simulink.ValueType(DataType="McSingle_T", Min=0, Unit="rpm", be=Simulink.BusElement(Name="a", DataType="double"))  % 机械转速
Time_S_V = Simulink.ValueType(DataType="McSingle_T", Min=0, Unit="s", be=Simulink.BusElement(Name="a", DataType="double"))  % 时间量
TorquePerAmp_NmPerA_V = Simulink.ValueType(DataType="McSingle_T", Unit="N*m/A", be=Simulink.BusElement(Name="a", DataType="double"))  % 转矩常数
Torque_Nm_V = Simulink.ValueType(DataType="McSingle_T", Unit="N*m", be=Simulink.BusElement(Name="a", DataType="double"))  % 转矩量
Voltage_V = Simulink.ValueType(DataType="McSingle_T", Min=0, Unit="V", be=Simulink.BusElement(Name="a", DataType="double"))  % 电压物理量

eMcCtrl = enum(DefaultValue="McNotStart", StorageType="uint8")
  McNotStart = 0  % 未启动
  McStart = 1  % 启动
  McExit = 2  % 退出

eMotorType = enum(DefaultValue="MC_MOTOR_NA", StorageType="uint8")
  MC_MOTOR_NA = 0  % 未定义
  MC_MOTOR_PMSM = 1  % 永磁同步电机
  MC_MOTOR_BLDC = 2  % 无刷直流电机
  MC_MOTOR_DCM = 3  % 有刷直流电机

ePosAlgo = enum(DefaultValue="PosNA", StorageType="uint8")
  PosNA = 0  % 未选择
  PosEncoder = 1  % 编码器
  PosHall = 2  % 霍尔传感器
  PosResolver = 3  % 旋变传感器
  PosBemf = 4  % 反电动势过零检测
  PosHfi = 5  % 高频注入法（HFI）
  PosFlux = 6  % 磁链观测器

eSmCmd = enum(DefaultValue="SmReset", StorageType="uint8")
  SmReset = 0  % 状态机复位
  FaultTrigger = 1  % 触发故障
  FaultClear = 2  % 清除故障
  AppOn = 3  % 应用开启
  AppOff = 4  % 应用关闭
  MotorRun = 5  % 电机运行
  MotorStop = 6  % 电机停止

eSmEvent = enum(StorageType="uint8")
  EventNA = 0  % 无事件
  InitDone = 1  % 初始化完成
  FaultDetected = 2  % 检测到故障
  StopDone = 3  % 停机完成
  Shutdown = 4  % 系统关闭
  AlignDone = 5  % 转子对齐完成
  OpenIfDone = 6  % 开环 I/F 启动完成
  OpenVfDone = 7  % 开环 V/F 启动完成
  TrackingDone = 8  % 位置跟踪完成
  RunBackward = 9  % 反转运行
  TrackingBackward = 10  % 反向跟踪

eSmStates = enum(StorageType="uint8")
  MC_STATE_RESET = 0  % 复位状态
  MC_STATE_INIT = 1  % 初始化状态
  MC_STATE_IDLE = 2  % 空闲状态
  MC_STATE_FAULT = 3  % 故障状态
  MC_STATE_READY = 4  % 就绪状态
  MC_STATE_READY_2_ALIGN = 5  % 就绪→对齐 过渡态
  MC_STATE_ALIGN = 6  % 转子对齐状态
  MC_STATE_ALIGN_2_OPEN_IF = 7  % 对齐→开环 I/F 过渡态
  MC_STATE_OPEN_IF = 8  % 开环 I/F 运行状态
  MC_STATE_OPEN_IF_2_TRACKING = 9  % 开环 I/F→跟踪 过渡态
  MC_STATE_TRACKING_2_OPEN_IF = 10  % 跟踪→开环 I/F 过渡态
  MC_STATE_TRACKING = 11  % 位置跟踪状态
  MC_STATE_TRACKING_2_RUN = 12  % 跟踪→闭环运行 过渡态
  MC_STATE_RUN_2_TRACKING = 13  % 闭环运行→跟踪 过渡态
  MC_STATE_RUN = 14  % 闭环运行状态
  MC_STATE_STOP = 15  % 停机状态

tActrDuty = Simulink.Bus()  % 三相六路 PWM 占空比，对应三相全桥逆变器的上下桥臂。
  AH: ValueType: DutyCount_V  % A 相上桥臂占空比
  AL: ValueType: DutyCount_V  % A 相下桥臂占空比
  BH: ValueType: DutyCount_V  % B 相上桥臂占空比
  BL: ValueType: DutyCount_V  % B 相下桥臂占空比
  CH: ValueType: DutyCount_V  % C 相上桥臂占空比
  CL: ValueType: DutyCount_V  % C 相下桥臂占空比

tAlgoPI = Simulink.Bus()  % 标准 PI 控制器参数结构。
  Kp: ValueType: Gain_V  % 比例增益
  Ki: ValueType: Gain_V  % 积分增益
  Ts: ValueType: Time_S_V  % 采样周期（秒）
  Integral: McSingle_T  % 积分累积值

tDataDualF32 = Simulink.Bus()  % 双路浮点数据包（如 αβ/dq 坐标对）
  D1: McSingle_T  % tDataDualF32 member 1
  D2: McSingle_T  % tDataDualF32 member 2

tDataDualU16 = Simulink.Bus()  % 双路 uint16 数据包
  D1: McUInt16_T  % tDataDualU16 member 1
  D2: McUInt16_T  % tDataDualU16 member 2

tDataHexaF32 = Simulink.Bus()  % 六路浮点数据包（如六路 PWM 占空比）
  D1: McSingle_T  % tDataHexaF32 member 1
  D2: McSingle_T  % tDataHexaF32 member 2
  D3: McSingle_T  % tDataHexaF32 member 3
  D4: McSingle_T  % tDataHexaF32 member 4
  D5: McSingle_T  % tDataHexaF32 member 5
  D6: McSingle_T  % tDataHexaF32 member 6

tDataHexaU16 = Simulink.Bus()  % 六路 uint16 数据包
  D1: McUInt16_T  % tDataHexaU16 member 1
  D2: McUInt16_T  % tDataHexaU16 member 2
  D3: McUInt16_T  % tDataHexaU16 member 3
  D4: McUInt16_T  % tDataHexaU16 member 4
  D5: McUInt16_T  % tDataHexaU16 member 5
  D6: McUInt16_T  % tDataHexaU16 member 6

tDataPentaF32 = Simulink.Bus()  % 五路浮点数据包
  D1: McSingle_T  % tDataPentaF32 member 1
  D2: McSingle_T  % tDataPentaF32 member 2
  D3: McSingle_T  % tDataPentaF32 member 3
  D4: McSingle_T  % tDataPentaF32 member 4
  D5: McSingle_T  % tDataPentaF32 member 5

tDataPentaU16 = Simulink.Bus()  % 五路 uint16 数据包
  D1: McUInt16_T  % tDataPentaU16 member 1
  D2: McUInt16_T  % tDataPentaU16 member 2
  D3: McUInt16_T  % tDataPentaU16 member 3
  D4: McUInt16_T  % tDataPentaU16 member 4
  D5: McUInt16_T  % tDataPentaU16 member 5

tDataQuadF32 = Simulink.Bus()  % 四路浮点数据包
  D1: McSingle_T  % tDataQuadF32 member 1
  D2: McSingle_T  % tDataQuadF32 member 2
  D3: McSingle_T  % tDataQuadF32 member 3
  D4: McSingle_T  % tDataQuadF32 member 4

tDataQuadU16 = Simulink.Bus()  % 四路 uint16 数据包
  D1: McUInt16_T  % tDataQuadU16 member 1
  D2: McUInt16_T  % tDataQuadU16 member 2
  D3: McUInt16_T  % tDataQuadU16 member 3
  D4: McUInt16_T  % tDataQuadU16 member 4

tDataTriF32 = Simulink.Bus()  % 三路浮点数据包（如三相物理量）
  D1: McSingle_T  % tDataTriF32 member 1
  D2: McSingle_T  % tDataTriF32 member 2
  D3: McSingle_T  % tDataTriF32 member 3

tDataTriU16 = Simulink.Bus()  % 三路 uint16 数据包
  D1: McUInt16_T  % tDataTriU16 member 1
  D2: McUInt16_T  % tDataTriU16 member 2
  D3: McUInt16_T  % tDataTriU16 member 3

tMcActuator = Simulink.Bus()  % 执行器顶层结构，包含执行器状态和 PWM 占空比。
  ActrState: McUInt8_T  % 执行器工作状态
  PwmDuty: Bus: tActrDuty  % PWM 占空比输出

tMcAlgorithm = Simulink.Bus()  % 电机控制算法集合，包含速度环和电流环 PI 控制器。
  SpdPI: Bus: tAlgoPI  % 速度环 PI 控制器
  IdPI: Bus: tAlgoPI  % d 轴电流环 PI 控制器
  IqPI: Bus: tAlgoPI  % q 轴电流环 PI 控制器

tMcCfg = Simulink.Bus()  % 电机控制系统配置参数。
  MotorNum: ValueType: MotorIndex_V  % 电机编号
  TuningEn: ValueType: LogicBool_V  % 在线调参使能
  DebugEn: ValueType: LogicBool_V  % 调试使能
  SampleRate: ValueType: Freq_Hz_V  % 采样频率（Hz）
  PwmFreq: ValueType: Freq_Hz_V  % PWM 开关频率（Hz）
  PosAlgo: Enum: ePosAlgo  % 位置估算算法选择

tMcDataFlow = Simulink.Bus()
  AngleElc: ValueType: AngleRad_V  % 电角度（rad）
  WElc: ValueType: AngularSpeedRadPerSec_V  % 电角速度（rad/s）
  WReqElc: ValueType: AngularSpeedRadPerSec_V  % 目标电角速度（rad/s）
  DcBusCurRaw: ValueType: AdcCurrentRaw_V  % 母线电流 ADC 原始值
  DcBusCurFlt: ValueType: Current_A_V  % 母线电流滤波值（A）
  DcBusVotRaw: ValueType: AdcVoltageRaw_V  % 母线电压 ADC 原始值
  DcBusVotFlt: ValueType: Voltage_V  % 母线电压滤波值（V）
  CurPhRaw: Bus: tDataTriU16  % 三相电流 ADC 原始值
  CurPhFlt: Bus: tDataTriF32  % 三相电流滤波值（A）
  CurAlBeFlt: Bus: tDataDualF32  % αβ 坐标系电流（Clarke 变换后）
  CurDqFlt: Bus: tDataDualF32  % dq 坐标系电流（Park 变换后）
  CurDqReqFlt: Bus: tDataDualF32  % dq 轴目标电流
  VotDqFlt: Bus: tDataDualF32  % dq 轴输出电压
  VotAlBeFlt: Bus: tDataDualF32  % αβ 坐标系输出电压（反 Park 变换后）
  VotPhFlt: Bus: tDataTriF32  % 三相输出电压（反 Clarke 变换后）
  DutyTriFlt: Bus: tDataTriF32  % 三相占空比（浮点）
  DutyHexaFlt: Bus: tDataHexaF32  % 六路占空比（浮点，含上下桥臂）

tMcDebug = Simulink.Bus()  % 调试信息结构，用于运行时数据监控。
  DebugEn: ValueType: LogicBool_V  % 调试使能开关
  DebugChannel: McUInt8_T  % 调试通道选择
  DebugData: McUInt8_T[8]  % 调试数据缓冲区（8 字节）

tMcDrive = Simulink.Bus()  % 电机控制驱动顶层结构，聚合了配置、状态机、调参、电机参数等所有子模块。
  BasicCnt: ValueType: Count_V  % 基础计数器（系统 tick）
  McCtrl: Enum: eMcCtrl  % 电机控制状态（启动/退出）
  McType: Bus: tMcType  % 电机控制类型配置
  StateMachine: Bus: tMcStateMachine  % 状态机
  DebugInfo: Bus: tMcDebug  % 调试信息
  Tunning: Bus: tMcTuning  % 在线调参参数
  McCfg: Bus: tMcCfg  % 系统配置
  MotorPara: Bus: tMotorPara  % 电机物理参数

tMcFault = Simulink.Bus()  % 故障信息结构，按模块分类记录故障标志。
  SnrFault: McUInt8_T  % 传感器故障标志
  AlgoFault: McUInt8_T  % 算法故障标志
  ActrFault: McUInt8_T  % 执行器故障标志
  HwFault: McUInt8_T  % 硬件故障标志

tMcObserver = Simulink.Bus()
  Flux: McSingle_T[2]  % 定子磁链积分状态，alpha/beta，Wb
  Theta: ValueType: AngleRad_V  % 估计电角度，rad
  Omega: ValueType: AngularSpeedRadPerSec_V  % 估计电角速度，rad/s
  Magnitude: ValueType: Flux_Wb_V  % 估计有效转子磁链幅值，Wb

tMcSensor = Simulink.Bus()  % 传感器聚合结构，汇集了所有传感器子模块的数据。
  AdcI: Bus: tSnrCur  % 三相电流 ADC 采样
  AdcV: Bus: tSnrVot  % 三相电压 ADC 采样
  Bemf: Bus: tSnrBemf  % 反电动势采样
  Hall: Bus: tSnrHall  % 霍尔传感器信号
  Resolver: Bus: tSnrResolver  % 旋变传感器信号
  Encoder: Bus: tSnrEncoder  % 编码器信号

tMcStateMachine = Simulink.Bus()
  State: Enum: eSmStates  % 当前状态机状态
  Cmd: Enum: eSmCmd  % 状态机控制指令
  Event: Enum: eSmEvent  % 状态机触发事件

tMcTuning = Simulink.Bus()  % 在线调参结构，用于运行时调整 PI 参数和启动参数。
  SpdKp: McUInt16_T  % 速度环比例增益
  SpdKi: McUInt16_T  % 速度环积分增益
  IdKp: McUInt16_T  % d 轴电流环比例增益
  IdKi: McUInt16_T  % d 轴电流环积分增益
  IqKp: McUInt16_T  % q 轴电流环比例增益
  IqKi: McUInt16_T  % q 轴电流环积分增益
  AlignCurrent: McUInt16_T  % 对齐电流设定值
  AlignTime: McUInt16_T  % 对齐时间设定值
  OpenLoopAccel: McUInt16_T  % 开环加速度
  TrackingGain: McUInt16_T  % 跟踪增益

tMcType = Simulink.Bus()  % 电机控制类型配置，定义系统所用的电机类型、算法类型等。
  MotorType: Enum: eMotorType  % 电机类型（PMSM/BLDC/DCM）
  AlgorithmType: McUInt8_T  % 控制算法类型
  SensorType: McUInt8_T  % 传感器类型
  ControlType: McUInt8_T  % 控制模式类型

tMotorPara = Simulink.Bus()  % 电机物理参数，用于 FOC 算法计算。
  NomVoltage: ValueType: Voltage_V  % 额定电压（V）
  NomCurrent: ValueType: Current_A_V  % 额定电流（A）
  NornSpd: ValueType: SpeedRpm_V  % 额定转速（RPM）
  PolePairNum: ValueType: PolePairCount_V  % 极对数
  Ld: ValueType: Inductance_H_V  % d 轴电感（H）
  Lq: ValueType: Inductance_H_V  % q 轴电感（H）
  Rs: ValueType: Resistance_Ohm_V  % 定子电阻（Ω）
  Bemf: ValueType: BemfConst_VsPerRad_V  % 反电动势常数
  Flux: ValueType: Flux_Wb_V  % 永磁磁链（Wb）
  RotorInertia: ValueType: Inertia_KgM2_V  % 转子转动惯量（kg·m²）
  Kt: ValueType: TorquePerAmp_NmPerA_V  % 转矩常数（N·m/A）
  Ke: ValueType: BemfConst_VsPerRad_V  % 反电动势常数（V·s/rad）
  Fdamp: McSingle_T  % 阻尼系数

tSnrBemf = Simulink.Bus()  % 反电动势（Back-EMF）检测信号，用于无传感器位置估算。
  BemfA: ValueType: AdcBemfRaw_V  % A 相反电动势 ADC 采样值
  BemfB: ValueType: AdcBemfRaw_V  % B 相反电动势 ADC 采样值
  BemfC: ValueType: AdcBemfRaw_V  % C 相反电动势 ADC 采样值

tSnrCur = Simulink.Bus()  % 三相电流采样信号。
  Ia: ValueType: AdcCurrentRaw_V  % A 相电流 ADC 采样值
  Ib: ValueType: AdcCurrentRaw_V  % B 相电流 ADC 采样值
  Ic: ValueType: AdcCurrentRaw_V  % C 相电流 ADC 采样值

tSnrEncoder = Simulink.Bus()  % 编码器传感器信号，用于增量式位置检测。
  A: ValueType: EncoderLevel_V  % A 路信号
  B: ValueType: EncoderLevel_V  % B 路信号
  C: ValueType: EncoderLevel_V  % C 路（Index）信号

tSnrHall = Simulink.Bus()  % 霍尔传感器信号，三路数字量输入，用于检测转子位置（60°分辨率）。
  HA: ValueType: HallLevel_V  % A 相霍尔信号
  HB: ValueType: HallLevel_V  % B 相霍尔信号
  HC: ValueType: HallLevel_V  % C 相霍尔信号

tSnrResolver = Simulink.Bus()  % 旋变传感器信号，用于高精度转子位置检测。
  A: ValueType: ResolverLevel_V  % A 路信号
  B: ValueType: ResolverLevel_V  % B 路信号
  C: ValueType: ResolverLevel_V  % C 路信号

tSnrVot = Simulink.Bus()  % 三相电压采样信号。
  Va: ValueType: AdcVoltageRaw_V  % A 相电压 ADC 采样值
  Vb: ValueType: AdcVoltageRaw_V  % B 相电压 ADC 采样值
  Vc: ValueType: AdcVoltageRaw_V  % C 相电压 ADC 采样值

tMcDrive_Param = Simulink.Parameter(struct(
  BasicCnt=uint32(0),
  McCtrl=eMcCtrl.McNotStart,
  McType=struct(MotorType=eMotorType.MC_MOTOR_PMSM, AlgorithmType=uint8(0), SensorType=uint8(0), ControlType=uint8(0)),
  StateMachine=struct(State=eSmStates.MC_STATE_RESET, Cmd=eSmCmd.SmReset, Event=eSmEvent.EventNA),
  DebugInfo=struct(DebugEn=false, DebugChannel=uint8(0), DebugData=uint8(repmat(0, 8, 1))),
  Tunning=struct(
    SpdKp=uint16(0),
    SpdKi=uint16(0),
    IdKp=uint16(0),
    IdKi=uint16(0),
    IqKp=uint16(0),
    IqKi=uint16(0),
    AlignCurrent=uint16(0),
    AlignTime=uint16(0),
    OpenLoopAccel=uint16(0),
    TrackingGain=uint16(0)),
  McCfg=struct(
    MotorNum=int8(0),
    TuningEn=false,
    DebugEn=false,
    SampleRate=uint32(16000),
    PwmFreq=uint32(16000),
    PosAlgo=ePosAlgo.PosNA),
  MotorPara=struct(
    NomVoltage=single(12),
    NomCurrent=single(0),
    NornSpd=single(0),
    PolePairNum=uint8(2),
    Ld=single(0.000375),
    Lq=single(0.000435),
    Rs=single(0.56),
    Bemf=single(0),
    Flux=single(0.00390522601),
    RotorInertia=single(1.2e-5),
    Kt=single(0.0117156785),
    Ke=single(0),
    Fdamp=single(0.0005))), DataType="Bus: tMcDrive")

McInput_Default = Simulink.Parameter(struct(
  CurrentRaw=uint16([32768; 32768; 32768]),
  Control=uint8(0),
  Fault=false,
  CommandEvent=true,
  DrivingEvent=true,
  TimerEvent=true,
  SpeedReq=single(0),
  Vdc=single(12),
  Position=single(0),
  AppliedVoltage=single([0; 0]),
  Tuning=struct(
    SpdKp=uint16(30),
    SpdKi=uint16(1294),
    IdKp=uint16(1178),
    IdKi=uint16(1759),
    IqKp=uint16(1367),
    IqKi=uint16(1759),
    AlignCurrent=uint16(1000),
    AlignTime=uint16(150),
    OpenLoopAccel=uint16(100),
    TrackingGain=uint16(80))), DataType="Bus: tMcInput")

tMcInput = Simulink.Bus()
  CurrentRaw: McUInt16_T[3]  % offset-binary 三相电流 ADC
  Control: McUInt8_T  % 0复位/撤使能、1运行、2受控停机
  Fault: ValueType: LogicBool_V  % 外部硬件故障电平
  CommandEvent: ValueType: LogicBool_V  % 命令帧有效
  DrivingEvent: ValueType: LogicBool_V  % 电流采样节拍有效
  TimerEvent: ValueType: LogicBool_V  % 慢周期诊断指示
  SpeedReq: ValueType: AngularSpeedRadPerSec_V  % 目标电角速度，rad/s
  Vdc: ValueType: Voltage_V  % 实测直流母线电压，V
  Position: ValueType: AngleRad_V  % 可选位置传感器电角度，rad；无感模式不使用
  AppliedVoltage: McSingle_T[2]  % 刚结束采样区间实际施加的有符号α/β平均电压，单位V；由上一拍PWM计数、门极状态和该区间母线电压重建，不使用转子真值
  Tuning: Bus: tMcTuning  % 待锁存调参帧

AmbdOutputsArmed = Simulink.Parameter(false, StorageClass="ExportedGlobal", Alias="Ambd_OutputsArmed", DataType="boolean")

tMcControlParams = Simulink.Bus()
  Ts: McSingle_T  % 控制标定；单位与默认值见 mc.defaults 和框架架构规格
  SpeedDivider: McUInt16_T  % 控制标定；单位与默认值见 mc.defaults 和框架架构规格
  AdcOffset: McSingle_T  % 控制标定；单位与默认值见 mc.defaults 和框架架构规格
  AdcCountsPerAmp: McSingle_T  % 控制标定；单位与默认值见 mc.defaults 和框架架构规格
  CalibrationSamples: McUInt16_T  % 启动零偏校准所需稳定采样数，默认64；仅整机层使用
  CalibrationMaxOffset: McSingle_T  % 零偏与标称ADC零点允许的最大偏差，默认500 count
  CalibrationMaxSpread: McSingle_T  % 同一次校准各通道最大极差，默认20 count
  CalibrationTimeout: McSingle_T  % 校准超时，按有效快速采样节拍累计，默认0.25 s
  PwmPeriod: McUInt16_T  % 控制标定；单位与默认值见 mc.defaults 和框架架构规格
  Rs: McSingle_T  % 控制标定；单位与默认值见 mc.defaults 和框架架构规格
  Ld: McSingle_T  % 控制标定；单位与默认值见 mc.defaults 和框架架构规格
  Lq: McSingle_T  % 控制标定；单位与默认值见 mc.defaults 和框架架构规格
  Flux: McSingle_T  % 控制标定；单位与默认值见 mc.defaults 和框架架构规格
  PolePairs: McUInt8_T  % 控制标定；单位与默认值见 mc.defaults 和框架架构规格
  Inertia: McSingle_T  % 控制标定；单位与默认值见 mc.defaults 和框架架构规格
  Friction: McSingle_T  % 控制标定；单位与默认值见 mc.defaults 和框架架构规格
  NominalVdc: McSingle_T  % 控制标定；单位与默认值见 mc.defaults 和框架架构规格
  VdcMin: McSingle_T  % 控制标定；单位与默认值见 mc.defaults 和框架架构规格
  VdcMax: McSingle_T  % 控制标定；单位与默认值见 mc.defaults 和框架架构规格
  CurrentLimit: McSingle_T  % 控制标定；单位与默认值见 mc.defaults 和框架架构规格
  TripCurrent: McSingle_T  % 控制标定；单位与默认值见 mc.defaults 和框架架构规格
  SpeedLimit: McSingle_T  % 控制标定；单位与默认值见 mc.defaults 和框架架构规格
  VoltageMargin: McSingle_T  % 控制标定；单位与默认值见 mc.defaults 和框架架构规格
  KpD: McSingle_T  % 控制标定；单位与默认值见 mc.defaults 和框架架构规格
  KpQ: McSingle_T  % 控制标定；单位与默认值见 mc.defaults 和框架架构规格
  KiD: McSingle_T  % 控制标定；单位与默认值见 mc.defaults 和框架架构规格
  KiQ: McSingle_T  % 控制标定；单位与默认值见 mc.defaults 和框架架构规格
  KpSpeed: McSingle_T  % 控制标定；单位与默认值见 mc.defaults 和框架架构规格
  KiSpeed: McSingle_T  % 控制标定；单位与默认值见 mc.defaults 和框架架构规格
  SpeedSlew: McSingle_T  % 控制标定；单位与默认值见 mc.defaults 和框架架构规格
  CurrentSlew: McSingle_T  % 开环及回退电流参考变化率，A/s
  AlignTime: McSingle_T  % 控制标定；单位与默认值见 mc.defaults 和框架架构规格
  AlignCurrent: McSingle_T  % 控制标定；单位与默认值见 mc.defaults 和框架架构规格
  OpenLoopCurrent: McSingle_T  % 控制标定；单位与默认值见 mc.defaults 和框架架构规格
  OpenLoopAccel: McSingle_T  % 控制标定；单位与默认值见 mc.defaults 和框架架构规格
  OpenLoopSpeed: McSingle_T  % 控制标定；单位与默认值见 mc.defaults 和框架架构规格
  TrackingTime: McSingle_T  % 控制标定；单位与默认值见 mc.defaults 和框架架构规格
  StartTimeout: McSingle_T  % 控制标定；单位与默认值见 mc.defaults 和框架架构规格
  ObserverBandwidth: McSingle_T  % 控制标定；单位与默认值见 mc.defaults 和框架架构规格
  ObserverSpeedBandwidth: McSingle_T  % 控制标定；单位与默认值见 mc.defaults 和框架架构规格
  ObserverMinSpeed: McSingle_T  % 控制标定；单位与默认值见 mc.defaults 和框架架构规格
  ObserverLockTime: McSingle_T  % 控制标定；单位与默认值见 mc.defaults 和框架架构规格
  StopDecel: McSingle_T  % 控制标定；单位与默认值见 mc.defaults 和框架架构规格
  StopSpeed: McSingle_T  % 控制标定；单位与默认值见 mc.defaults 和框架架构规格
  StopTimeout: McSingle_T  % 控制标定；单位与默认值见 mc.defaults 和框架架构规格
  PositionMode: McUInt8_T  % 控制标定；单位与默认值见 mc.defaults 和框架架构规格
  TuningEnable: ValueType: LogicBool_V  % 控制标定；单位与默认值见 mc.defaults 和框架架构规格

tMcCoreInput = Simulink.Bus()
  Current: McSingle_T[3]  % 已处理的三相电流，A，无ADC编码
  Control: McUInt8_T  % 0复位/撤使能、1运行、2受控停止
  Fault: ValueType: LogicBool_V  % 外部故障电平，核心锁存
  Disable: ValueType: LogicBool_V  % 立即禁止输出；不依赖快速节拍，不等同受控停止
  CommandEvent: ValueType: LogicBool_V  % 命令帧有效
  DrivingEvent: ValueType: LogicBool_V  % 电流采样节拍有效
  TimerEvent: ValueType: LogicBool_V  % 保留的诊断事件，不产生额外积分
  SpeedReq: ValueType: AngularSpeedRadPerSec_V  % 目标电角速度，rad/s
  Vdc: ValueType: Voltage_V  % 实测直流母线电压，V
  Position: ValueType: AngleRad_V  % 有感模式电角度，rad；无感模式不使用
  AppliedVoltage: McSingle_T[2]  % 与当前电流对应的实际施加alpha/beta电压，V
  Tuning: Bus: tMcTuning  % 待锁存调参帧

tMcCoreRuntime = Simulink.Bus()
  Tick: McUInt32_T  % 显式离散控制状态；生命周期和单位见 pmsm-framework-architecture.md
  Mode: McUInt8_T  % 显式离散控制状态；生命周期和单位见 pmsm-framework-architecture.md
  PreviousMode: McUInt8_T  % 显式离散控制状态；生命周期和单位见 pmsm-framework-architecture.md
  ModeTicks: McUInt32_T  % 显式离散控制状态；生命周期和单位见 pmsm-framework-architecture.md
  FaultBits: McUInt16_T  % 显式离散控制状态；生命周期和单位见 pmsm-framework-architecture.md
  ActiveFaults: McUInt16_T  % 显式离散控制状态；生命周期和单位见 pmsm-framework-architecture.md
  FastTick: ValueType: LogicBool_V  % 显式离散控制状态；生命周期和单位见 pmsm-framework-architecture.md
  SlowTick: ValueType: LogicBool_V  % 显式离散控制状态；生命周期和单位见 pmsm-framework-architecture.md
  Command: McUInt8_T  % 显式离散控制状态；生命周期和单位见 pmsm-framework-architecture.md
  Direction: McSingle_T  % 显式离散控制状态；生命周期和单位见 pmsm-framework-architecture.md
  SpeedRequest: McSingle_T  % 显式离散控制状态；生命周期和单位见 pmsm-framework-architecture.md
  SpeedRamp: McSingle_T  % 显式离散控制状态；生命周期和单位见 pmsm-framework-architecture.md
  ThetaOpen: McSingle_T  % 显式离散控制状态；生命周期和单位见 pmsm-framework-architecture.md
  OmegaOpen: McSingle_T  % 显式离散控制状态；生命周期和单位见 pmsm-framework-architecture.md
  ThetaControl: McSingle_T  % 显式离散控制状态；生命周期和单位见 pmsm-framework-architecture.md
  OmegaControl: McSingle_T  % 显式离散控制状态；生命周期和单位见 pmsm-framework-architecture.md
  ReferenceDq: McSingle_T[2]  % 显式离散控制状态；生命周期和单位见 pmsm-framework-architecture.md
  CurrentIntegral: McSingle_T[2]  % 显式离散控制状态；生命周期和单位见 pmsm-framework-architecture.md
  SpeedIntegral: McSingle_T  % 显式离散控制状态；生命周期和单位见 pmsm-framework-architecture.md
  Current: McSingle_T[3]  % 显式离散控制状态；生命周期和单位见 pmsm-framework-architecture.md
  CurrentDq: McSingle_T[2]  % 显式离散控制状态；生命周期和单位见 pmsm-framework-architecture.md
  Voltage: McSingle_T[2]  % 本拍调制命令alpha/beta电压（非实际反馈），单位V；生命周期见 pmsm-framework-architecture.md
  Duty: McSingle_T[3]  % 显式离散控制状态；生命周期和单位见 pmsm-framework-architecture.md
  GateEnable: ValueType: LogicBool_V  % 显式离散控制状态；生命周期和单位见 pmsm-framework-architecture.md
  StopOpenLoop: ValueType: LogicBool_V  % 无可信位置时从最后有效控制坐标系执行受控停机
  ObserverReady: ValueType: LogicBool_V  % 显式离散控制状态；生命周期和单位见 pmsm-framework-architecture.md
  ObserverGoodTicks: McUInt32_T  % 显式离散控制状态；生命周期和单位见 pmsm-framework-architecture.md
  Observer: Bus: tMcObserver  % 显式离散控制状态；生命周期和单位见 pmsm-framework-architecture.md
  PositionPrev: McSingle_T  % 显式离散控制状态；生命周期和单位见 pmsm-framework-architecture.md
  PositionSpeed: McSingle_T  % 显式离散控制状态；生命周期和单位见 pmsm-framework-architecture.md
  Gains: McSingle_T[6]  % 显式离散控制状态；生命周期和单位见 pmsm-framework-architecture.md
  Startup: McSingle_T[4]  % 显式离散控制状态；生命周期和单位见 pmsm-framework-architecture.md

tMcMonitor = Simulink.Bus()
  Mode: McUInt8_T  % 兼容eSmStates的诊断映射，独立核心仅使用算法相关状态码
  FaultBits: McUInt16_T  % 锁存故障位图
  Tick: McUInt32_T  % 电流环累计采样计数
  SpeedRequest: ValueType: AngularSpeedRadPerSec_V  % 限幅后的目标电角速度
  Omega: ValueType: AngularSpeedRadPerSec_V  % 控制使用的电角速度
  Theta: ValueType: AngleRad_V  % 控制使用的电角度
  Current: McSingle_T[3]  % 三相电流，A
  CurrentDq: McSingle_T[2]  % dq电流，A
  ReferenceDq: McSingle_T[2]  % dq目标电流，A
  Voltage: McSingle_T[2]  % 本拍调制命令alpha/beta电压（非实际反馈），单位V
  Duty: McSingle_T[3]  % 归一化三相占空比
  GateEnable: ValueType: LogicBool_V  % 独立功率级使能
  ObserverReady: ValueType: LogicBool_V  % 观测器置信度通过
  FluxMagnitude: ValueType: Flux_Wb_V  % 观测磁链幅值
  PositionMode: McUInt8_T  % 0无感、1位置传感器
  CoreMode: McUInt8_T  % 核心算法状态，0/2禁用、3故障、6–15算法阶段
  ApplicationMode: McUInt8_T  % 整机状态0–5；独立核心为255（不适用）
  CalibrationDone: ValueType: LogicBool_V  % 整机校准完成；独立核心为false（不适用）
  CalibrationCount: McUInt16_T  % 整机稳定校准采样数；独立核心为0
  StopComplete: ValueType: LogicBool_V  % 核心已停止且门极关闭

tMcRuntime = Simulink.Bus()  % 整机状态与核心算法状态分开存储。外层不能修改核心的算法阶段；通过命令请求、核心返回状态与故障握手。
  Mode: McUInt8_T  % 整机状态：0复位、1初始化/校准、2空闲、3故障、4就绪、5核心活动
  Command: McUInt8_T  % 已接受的用户命令：0复位、1运行、2受控停止
  PreviousCommandEvent: ValueType: LogicBool_V  % 上拍命令帧有效电平；识别新的安全复位请求
  SpeedRequest: ValueType: AngularSpeedRadPerSec_V  % 已接受且限幅的目标电角速度
  FaultBits: McUInt16_T  % 整机锁存故障，含核心返回故障；1024为校准失败
  ActiveFaults: McUInt16_T  % 本拍原始采样与外部输入故障
  Calibrated: ValueType: LogicBool_V  % 零偏校准有效，运行资格之一
  CalibrationCount: McUInt16_T  % 已累积的稳定采样数
  CalibrationTicks: McUInt32_T  % 校准期间有效快速采样节拍数
  CalibrationSum: McSingle_T[3]  % 三相ADC校准累积值，count
  CalibrationMin: McSingle_T[3]  % 三相ADC校准最小值，count
  CalibrationMax: McSingle_T[3]  % 三相ADC校准最大值，count
  AdcOffsets: McSingle_T[3]  % 已应用的各通道零偏，count
  Core: Bus: tMcCoreRuntime  % 唯一的FOC核心状态，由共享FocCore更新

McControl_Params = Simulink.Parameter(struct(
  Ts=single(6.25e-5),
  SpeedDivider=uint16(16),
  AdcOffset=single(32768),
  AdcCountsPerAmp=single(1000),
  CalibrationSamples=uint16(64),
  CalibrationMaxOffset=single(500),
  CalibrationMaxSpread=single(20),
  CalibrationTimeout=single(0.25),
  PwmPeriod=uint16(65535),
  Rs=single(0.56),
  Ld=single(0.000375),
  Lq=single(0.000435),
  Flux=single(0.00390522601),
  PolePairs=uint8(2),
  Inertia=single(1.2e-5),
  Friction=single(0.0005),
  NominalVdc=single(12),
  VdcMin=single(8),
  VdcMax=single(16),
  CurrentLimit=single(6),
  TripCurrent=single(10),
  SpeedLimit=single(250),
  VoltageMargin=single(0.9),
  KpD=single(1.17809725),
  KpQ=single(1.36659288),
  KiD=single(1759.29199),
  KiQ=single(1759.29199),
  KpSpeed=single(0.0301464256),
  KiSpeed=single(1.29396808),
  SpeedSlew=single(300),
  CurrentSlew=single(100),
  AlignTime=single(0.15),
  AlignCurrent=single(1),
  OpenLoopCurrent=single(3.5),
  OpenLoopAccel=single(100),
  OpenLoopSpeed=single(120),
  TrackingTime=single(0.2),
  StartTimeout=single(3),
  ObserverBandwidth=single(80),
  ObserverSpeedBandwidth=single(150),
  ObserverMinSpeed=single(60),
  ObserverLockTime=single(0.05),
  StopDecel=single(500),
  StopSpeed=single(15),
  StopTimeout=single(1),
  PositionMode=uint8(0),
  TuningEnable=false), DataType="Bus: tMcControlParams")

McRuntime_Init = Simulink.Parameter(struct(
  Mode=uint8(0),
  Command=uint8(0),
  PreviousCommandEvent=false,
  SpeedRequest=single(0),
  FaultBits=uint16(0),
  ActiveFaults=uint16(0),
  Calibrated=false,
  CalibrationCount=uint16(0),
  CalibrationTicks=uint32(0),
  CalibrationSum=single([0; 0; 0]),
  CalibrationMin=single([65535; 65535; 65535]),
  CalibrationMax=single([0; 0; 0]),
  AdcOffsets=single([32768; 32768; 32768]),
  Core=struct(
    Tick=uint32(0),
    Mode=uint8(0),
    PreviousMode=uint8(0),
    ModeTicks=uint32(0),
    FaultBits=uint16(0),
    ActiveFaults=uint16(0),
    FastTick=false,
    SlowTick=false,
    Command=uint8(0),
    Direction=single(1),
    SpeedRequest=single(0),
    SpeedRamp=single(0),
    ThetaOpen=single(0),
    OmegaOpen=single(0),
    ThetaControl=single(0),
    OmegaControl=single(0),
    ReferenceDq=single([0; 0]),
    CurrentIntegral=single([0; 0]),
    SpeedIntegral=single(0),
    Current=single([0; 0; 0]),
    CurrentDq=single([0; 0]),
    Voltage=single([0; 0]),
    Duty=single([0.5; 0.5; 0.5]),
    GateEnable=false,
    StopOpenLoop=false,
    ObserverReady=false,
    ObserverGoodTicks=uint32(0),
    Observer=struct(Flux=single([0.00390522601; 0]), Theta=single(0), Omega=single(0), Magnitude=single(0.00390522601)),
    PositionPrev=single(0),
    PositionSpeed=single(0),
    Gains=single([0.0301464256; 1.29396808; 1.17809725; 1759.29199; 1.36659288; 1759.29199]),
    Startup=single([1; 0.15; 100; 80]))), DataType="Bus: tMcRuntime")

McPlant_Params = Simulink.Parameter(struct(
  Ts=single(6.25e-5),
  SpeedDivider=uint16(16),
  AdcOffset=single(32768),
  AdcCountsPerAmp=single(1000),
  CalibrationSamples=uint16(64),
  CalibrationMaxOffset=single(500),
  CalibrationMaxSpread=single(20),
  CalibrationTimeout=single(0.25),
  PwmPeriod=uint16(65535),
  Rs=single(0.56),
  Ld=single(0.000375),
  Lq=single(0.000435),
  Flux=single(0.00390522601),
  PolePairs=uint8(2),
  Inertia=single(1.2e-5),
  Friction=single(0.0005),
  NominalVdc=single(12),
  VdcMin=single(8),
  VdcMax=single(16),
  CurrentLimit=single(6),
  TripCurrent=single(10),
  SpeedLimit=single(250),
  VoltageMargin=single(0.9),
  KpD=single(1.17809725),
  KpQ=single(1.36659288),
  KiD=single(1759.29199),
  KiQ=single(1759.29199),
  KpSpeed=single(0.0301464256),
  KiSpeed=single(1.29396808),
  SpeedSlew=single(300),
  CurrentSlew=single(100),
  AlignTime=single(0.15),
  AlignCurrent=single(1),
  OpenLoopCurrent=single(3.5),
  OpenLoopAccel=single(100),
  OpenLoopSpeed=single(120),
  TrackingTime=single(0.2),
  StartTimeout=single(3),
  ObserverBandwidth=single(80),
  ObserverSpeedBandwidth=single(150),
  ObserverMinSpeed=single(60),
  ObserverLockTime=single(0.05),
  StopDecel=single(500),
  StopSpeed=single(15),
  StopTimeout=single(1),
  PositionMode=uint8(0),
  TuningEnable=false), DataType="Bus: tMcControlParams")

McCoreRuntime_Init = Simulink.Parameter(struct(
  Tick=uint32(0),
  Mode=uint8(0),
  PreviousMode=uint8(0),
  ModeTicks=uint32(0),
  FaultBits=uint16(0),
  ActiveFaults=uint16(0),
  FastTick=false,
  SlowTick=false,
  Command=uint8(0),
  Direction=single(1),
  SpeedRequest=single(0),
  SpeedRamp=single(0),
  ThetaOpen=single(0),
  OmegaOpen=single(0),
  ThetaControl=single(0),
  OmegaControl=single(0),
  ReferenceDq=single([0; 0]),
  CurrentIntegral=single([0; 0]),
  SpeedIntegral=single(0),
  Current=single([0; 0; 0]),
  CurrentDq=single([0; 0]),
  Voltage=single([0; 0]),
  Duty=single([0.5; 0.5; 0.5]),
  GateEnable=false,
  StopOpenLoop=false,
  ObserverReady=false,
  ObserverGoodTicks=uint32(0),
  Observer=struct(Flux=single([0.00390522601; 0]), Theta=single(0), Omega=single(0), Magnitude=single(0.00390522601)),
  PositionPrev=single(0),
  PositionSpeed=single(0),
  Gains=single([0.0301464256; 1.29396808; 1.17809725; 1759.29199; 1.36659288; 1759.29199]),
  Startup=single([1; 0.15; 100; 80])), DataType="Bus: tMcCoreRuntime")

McCoreInput_Default = Simulink.Parameter(struct(
  Current=single([0; 0; 0]),
  Control=uint8(0),
  Fault=false,
  Disable=false,
  CommandEvent=true,
  DrivingEvent=true,
  TimerEvent=true,
  SpeedReq=single(0),
  Vdc=single(12),
  Position=single(0),
  AppliedVoltage=single([0; 0]),
  Tuning=struct(
    SpdKp=uint16(30),
    SpdKi=uint16(1294),
    IdKp=uint16(1178),
    IdKi=uint16(1759),
    IqKp=uint16(1367),
    IqKi=uint16(1759),
    AlignCurrent=uint16(1000),
    AlignTime=uint16(150),
    OpenLoopAccel=uint16(100),
    TrackingGain=uint16(80))), DataType="Bus: tMcCoreInput")